# Grasshopper definition packing.gh (Grasshopper 1.0.7)

genes = GenePool(Decimals=2, Maximum=1, Minimum=0, Value=[1, 0.16, 0.79, 0.87, 0.38, 0.86, 0.85, 0.26, 0.17, 1])
genes_2 = GenePool(Decimals=2, Maximum=1, Minimum=0, Value=[0.99, 0.06, 0.88, 0.95, 0.12, 1, 0.94, 0.35, 0.73, 0.9])

python = GhPythonScript()  # -> out, data_path
# ---------- python: Python ----------
import sys
import Rhino.Geometry as rh

### GET LOCAL PATH
gh_path = ghenv.Component.OnPingDocument().FilePath.split("\\")
print "Local GH path: {}".format(gh_path)

data_path = "\\".join(gh_path[:-1] + ["rooms.json"])
# ---------- end python ----------
file = ReadFile(File=python.data_path, PerLineParse=False)
python_2 = GhPythonScript(file=file)  # -> out, names, areas
# ---------- python_2: Python ----------
import json

items = json.loads(file)

names = [item["name"] for item in items]
areas = [item["area"] for item in items]

adjacencies = {}

for item in items:
    adjacencies[item["name"]] = item["adjacency"]

adjacencies = json.dumps(adjacencies)
# ---------- end python_2 ----------

remap = RemapNumbers(Value=genes, Source=Domain(0, 1), Target="0 to 10")  # -> Mapped, Clipped
remap_2 = RemapNumbers(Value=genes_2, Source=Domain(0, 1), Target="0 to 10")  # -> Mapped, Clipped
pt = ConstructPoint(XCoordinate=remap.Mapped, YCoordinate=remap_2.Mapped, ZCoordinate=0)
sqrt = SquareRoot(Value=python_2.areas)
python_3 = GhPythonScript(pts=pt, max_iters=Slider(202, range=0..1000), alpha=Slider(0.67, range=0..1), radii=sqrt)  # -> out, pts, circles, iters; inputs pts: list of Point3d, max_iters: Int32, radii: list
# ---------- python_3: Python ----------
import sys
import Rhino.Geometry as rh

### GET LOCAL PATH
gh_path = ghenv.Component.OnPingDocument().FilePath.split("\\")
print "Local GH path: {}".format(gh_path)

#scripts_path = "\\".join(gh_path[:-1] + ["_scripts"])
#if scripts_path not in sys.path: sys.path.append(scripts_path)

import packing
reload(packing)

###


agents = []

for i,pt in enumerate(pts):
    my_agent = packing.Agent(pt, radii[i])
    agents.append(my_agent)

# for each agent in the list, add the previous agent as its neighbor
for i in range(len(agents)):
    agents[i].add_neighbor(agents[i-1])

for i in range(max_iters):
    
    total_amount = 0
    
    for j,agent_1 in enumerate(agents):
        
        # cluster to all agent's neighbors
        for agent_2 in agent_1.neighbors:
            total_amount += agent_1.cluster(agent_2, alpha)
        
        # collide with all agents after agent in list
        for agent_2 in agents[j+1:]:
            total_amount += agent_1.collide(agent_2, alpha/5) ## add extra multiplier to decrease effect of cluster
    
    if total_amount < .01:
        break

iters = i

print "process ran for {} iterations".format(i)

circles = []

for agent in agents:
    circles.append(agent.get_circle())
# ---------- end python_3 ----------
panel = Panel(python_3.iters)
bbox = BoundingBox(Content=python_3.circles, Plane=PlaneXY(0, 0, 0), UnionBox=True)  # -> Box, Box_2
vec2pt = Vector2Pt(PointA=pt, PointB=python_3.pts, Unitize=False)  # -> Vector, Length
tag = TextTag(Location=python_3.pts, Text=python_2.names)
wires = BrepWireframe(Brep=bbox.Box, Density=-1)
area = Area(Geometry=bbox.Box)  # -> Area, Centroid
vdis = VectorDisplay(Anchor=pt, Vector=vec2pt.Vector)
galapagos = Galapagos(fitness=area, gene=[genes, genes_2])
